# Grasshopper definition pv_simulation.gh (Grasshopper 1.0.7)
# plug-ins: HDTTreeUtils, Human, Pufferfish, CORE.Grasshopper.Colibri

panel = Panel("""historical,2020
ssp126,2020-2050
ssp126,2035-2065
ssp126,2050-2080
ssp126,2065-2095
ssp245,2020-2050
ssp245,2035-2065
ssp245,2050-2080
ssp245,2065-2095
ssp585,2020-2050
ssp585,2035-2065
ssp585,2050-2080
ssp585,2065-2095""")
panel_2 = Panel("""1a
2a
2b
3a
3b
3bc
3c
4a
4b
4c
5a
5b
6a
6b
7a
8a""")
value_list = ValueList({"historical", "ssp126", "ssp245", "ssp585"}, selected="ssp126")
value_list_2 = ValueList({"2020", "2035": "2020-2050", "2050": "2035-2065", "2065": "2050-2080", "2080": "2065-2095"}, selected="2035")
panel_3 = Panel("""RefBldgMidriseApartment
RefBldgMediumOffice""")
project_root = FilePath("C:\Users\Justin\Documents\GitHub\cmip6_and_buildings\")
in_scen_year = Slider(0, range=0..12)
list_item = ListItem(List=panel, Index=in_scen_year, Wrap=True)
text_split = TextSplit(Text=list_item, Separators=",")
list_item_2 = ListItem(List=text_split, Index=1, Wrap=True)
list_item_3 = ListItem(List=text_split, Index=0, Wrap=True)
in_building_type = Slider(0, range=0..1)
list_item_4 = ListItem(List=panel_3, Index=in_building_type, Wrap=True)
in_vintage = ValueList({"new", "pre1980", "post1980"}, selected="new")
in_climate_zone = Slider(0, range=0..15)
list_item_5 = ListItem(List=panel_2, Index=in_climate_zone, Wrap=True)
ghpython_script = GhPythonScript(
    project_root=project_root,
    cz=list_item_5,
    building_type=list_item_4,
    vintage=in_vintage,
    scenario=list_item_3,
    year=list_item_2)  # -> out, idf_file
# ---------- ghpython_script: Python ----------
__author__ = "Justin"
__version__ = "2023.05.05"

import rhinoscriptsyntax as rs
import os
import glob
if vintage=='new':
    vintage_path = 'New2004'
elif vintage=='post1980':
    vintage_path = 'Post1980'
elif vintage=='pre1980':
    vintage_path = 'Pre1980'
    
version_dir = os.path.join(project_root, 'eplus_simulations',vintage,'idf_files','v22_2')
idf_file = glob.glob(os.path.join(version_dir, cz+"_"+vintage+"_"+"v22_2",building_type+vintage_path+"*"))[0]
# ---------- end ghpython_script ----------
value_list_3 = ValueList({"total", "direct"}, selected="total")
run_irradiance = BooleanToggle(False)
radpar = HBRadianceParameter(recipe_type=Slider(2, range=0..2), detail_level=Slider(1, range=0..2))  # -> rad_par; plug-in component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
tilt_angle = Slider(10, range=0..90)
roof_useable_area = Slider(0.8, range=0..1)
tilt_angle_2 = Slider(15, range=0..90)
model_path = FilePath(ghpython_script.idf_file)
ghpython_script_2 = GhPythonScript(idf_file=model_path, scenario=list_item_3, year=list_item_2)  # -> out, building_type, epw_file, project_dir, vintage, climate_zone
# ---------- ghpython_script_2: Python ----------
__author__ = "Justin"
__version__ = "2023.05.05"

import rhinoscriptsyntax as rs
import os
import sys
import glob

path_el = idf_file.split(os.sep)
building_type = path_el[-1].split("_")[0]
climate_zone = path_el[-2].split("_")[0].lower()
vintage = path_el[7]
project_dir =  os.path.join(r'C:\\',path_el[1],path_el[2],path_el[3],path_el[4],path_el[5])
weather_root = os.path.join(project_dir,'weather_files')
print(path_el)
if scenario == 'historical':
    year = 2020
    epw_file = glob.glob(os.path.join(weather_root, 'tmy3', climate_zone + '*'))[0]
else:
    if year==2020:
        scenario = 'historical'
        epw_file = glob.glob(os.path.join(weather_root, 'tmy3', climate_zone + '*'))[0]
    else:
        epw_dir = os.path.join(weather_root, 'morphed', climate_zone, scenario, 'EPWs')
        epw_file = glob.glob(os.path.join(epw_dir, "*_50_" + year + "*.epw"))[0]
        print(os.path.exists(epw_file))
# ---------- end ghpython_script_2 ----------
ghpython_script_3 = GhPythonScript(x=ghpython_script_2.climate_zone, y=ghpython_script_2.building_type)  # -> out, a
# ---------- ghpython_script_3: Python ----------
__author__ = "Justin"
__version__ = "2023.05.13"


a = x+"_"+y
# ---------- end ghpython_script_3 ----------
epwpath = FilePath(ghpython_script_2.epw_file)
load_model = BooleanToggle(True)
panel_4 = Panel(model_path)
panel_5 = Panel(ghpython_script_2.epw_file)
colibri_inputs_iterator = ColibriInputsIterator(in_climate_zone=in_climate_zone, in_building_type=in_building_type, in_scen_year=in_scen_year, ignoreAllWarningMsg=True)  # -> Unique_Name, Inputs, in_climate_zone, in_building_type, in_scen_year, V_N
stream_filter = StreamFilter(Gate=in_building_type, Stream0=tilt_angle_2, Stream1=tilt_angle)

# ---- group: Get Cell and Module Information / Panelizer Scenario
list = ValueList({"Monocrystalline": "A", "Polycrystalline": "B", "CdTe": "C", "CIGS": "D", "aSi": "E", "NIST": "N"}, selected="Monocrystalline")
list_2 = ValueList({"Portrait": "P", "Landscape": "L"}, selected="Landscape")
concat = Concatenate(FragmentA=list, FragmentB=list_2)

# ----
ghpython_script_4 = GhPythonScript(
    project_dir=ghpython_script_2.project_dir,
    building_type=ghpython_script_2.building_type,
    climate_zone=ghpython_script_2.climate_zone,
    vintage=ghpython_script_2.vintage,
    pv_config=concat,
    scenario=list_item_3,
    year=list_item_2)  # -> out, irradiance_dir
# ---------- ghpython_script_4: Python ----------
__author__ = "Justin"
__version__ = "2023.05.05"

import rhinoscriptsyntax as rs
import os

if year==2020:
    pass
else:
    year =int((int( year.split("-")[-1]) - int(year.split("-")[0])) / 2 + int(year.split("-")[0]))

scen_year = str(scenario) + "_" + str(year)

main_dir = os.path.join(project_dir, 'eplus_simulations',vintage,'results')
pv_dir = os.path.join(main_dir, 'irrad_results', climate_zone, scen_year)
results_dir = os.path.join(pv_dir, building_type)
irradiance_dir = os.path.join(results_dir, 'irrad')
if os.path.exists(irradiance_dir):
    pass
else:
    os.makedirs(irradiance_dir)
    pass
# ---------- end ghpython_script_4 ----------
ghpython_script_5 = GhPythonScript(x=ghpython_script_4.irradiance_dir, y=value_list_3)  # -> out, a
# ---------- ghpython_script_5: Python ----------
__author__ = "Justin"
__version__ = "2023.05.05"

import rhinoscriptsyntax as rs
import os

a = os.path.join(x, 'annual_irradiance', 'results', y)
# ---------- end ghpython_script_5 ----------
recipesettings = HBRecipeSettings(folder=ghpython_script_4.irradiance_dir, reload_old=False)  # -> settings; plug-in component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
cell_info_table = FilePath("C:\Users\Justin\Documents\GitHub\IPV_Workbench\ipv_workbench\devices\default_devices\cell_module_datasheet.csv")
loademodel = HBLoadGbXMLOSMIDF(model_file=model_path, load=load_model)  # -> out, model; plug-in component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
importepw = LBImportEPW(epw_file=epwpath)  # -> location, dry_bulb_temperature, dew_point_temperature, relative_humidity, wind_speed, wind_direction, direct_normal_rad, diffuse_horizontal_rad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; plug-in component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
panel_6 = Panel(importepw.location)
deconstructmodel = HBDeconstructModel(model=loademodel.model)  # -> rooms, faces, apertures, doors, shades; plug-in component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
series = Series(Start=Slider(9, range=0..10), Step=1, Count=Slider(6, range=0..10))
ghpython_script_6 = GhPythonScript(building_type=in_building_type)  # -> out, worst_hour
# ---------- ghpython_script_6: Python ----------
__author__ = "Justin"
__version__ = "2023.05.06"

import rhinoscriptsyntax as rs

if building_type == 0:
    worst_hour = 18
else:
    worst_hour = 14
# ---------- end ghpython_script_6 ----------
number_slider = Slider(15, range=0..100)
vizwiref = HBVisualizeWireframe(hb_objs=flatten(loademodel.model))  # -> geo; plug-in component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
geoprop = HBGeometryProperties(rooms=flatten(deconstructmodel.rooms))  # -> ext_wall_area, ext_win_area, volume, floor_area, floor_ep_constr; plug-in component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
vizbytype = HBVisualizeByType(hb_objs=deconstructmodel.rooms)  # -> walls, interior_walls, roofs, ceilings, exterior_floors, interior_floors, air_walls, apertures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; plug-in component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
hoy = LBCalculateHOY(month=Slider(12, range=0..100), day=Slider(21, range=0..100), hour=ghpython_script_6.worst_hour)  # -> flatten(hoy), flatten(doy), flatten(date); plug-in component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
sunpath = LBSunPath(location=importepw.location, hoys=hoy.hoy, solar_time=Toggle(False), scale=1)  # -> out, vectors, altitudes, azimuths, hoys, sun_pts, analemma, daily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; plug-in component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
list_item_6 = ListItem(List=panel_2, Index=colibri_inputs_iterator.in_climate_zone, Wrap=True)
list_item_7 = ListItem(List=panel_3, Index=colibri_inputs_iterator.in_building_type, Wrap=True)
list_item_8 = ListItem(List=panel, Index=colibri_inputs_iterator.in_scen_year, Wrap=True)
data = Data(in_vintage)
ghpython_script_7 = GhPythonScript(elevation=sunpath.altitudes, azimuth=sunpath.azimuths)  # -> out, elevation_out, azimuth_out
# ---------- ghpython_script_7: Python ----------
__author__ = "Justin"
__version__ = "2023.05.06"

import rhinoscriptsyntax as rs

if elevation is None:
    elevation_out = 17
else:
    elevation_out = elevation
    
if azimuth is None:
    azimuth_out = 220
else:
    azimuth_out = azimuth
# ---------- end ghpython_script_7 ----------
mesh = Mesh(vizbytype.roofs)
face_boundaries = FaceBoundaries(Mesh=mesh)
custom_preview = CustomPreview(
    Geometry=vizbytype.apertures,
    Material={diffuse=RGB(221, 160, 221), emission=RGB(66, 48, 66), shine=0.5, specular=RGB(255, 255, 255), transparency=0})
custom_preview_2 = CustomPreview(
    Geometry=[vizbytype.walls, vizbytype.ceilings],
    Material={diffuse=RGB(221, 160, 221), emission=RGB(66, 48, 66), shine=0.5, specular=RGB(255, 255, 255), transparency=0})
custom_preview_3 = CustomPreview(
    Geometry=vizbytype.roofs,
    Material={diffuse=RGB(221, 160, 221), emission=RGB(66, 48, 66), shine=0.5, specular=RGB(255, 255, 255), transparency=0})
join_curves = JoinCurves(Curves=face_boundaries, Preserve=False)
maximum = Maximum(A=ghpython_script_7.elevation_out, B=Slider(17, range=0..100))
surface = Surface(join_curves)
brep_join = BrepJoin(Breps=surface)  # -> Breps, Closed
merge_faces = MergeFaces(Brep=brep_join.Breps)  # -> Breps, Before, After
area = Area(Geometry=merge_faces.Breps)  # -> Area, Centroid
scale = Scale(Geometry=merge_faces.Breps, Center=area.Centroid, Factor=roof_useable_area)  # -> Geometry, Transform
brep_edges = BrepEdges(Brep=scale.Geometry)  # -> Naked, Interior, NonManifold
join_curves_2 = JoinCurves(Curves=brep_edges.Naked, Preserve=False)
sine = Sine(Value=degrees(stream_filter))
cosine = Cosine(Value=degrees(stream_filter))
surface_2 = Surface(join_curves_2)
deconstruct_brep = DeconstructBrep(Brep=surface_2)  # -> Faces, Edges, Vertices
list_item_9 = ListItem(List=deconstruct_brep.Vertices, Index=0, Wrap=True)
unit_x = UnitX(Factor=1)
panel_7 = Panel("""0
1""")
office = Geometry(Tree({0}: [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], {1}: [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]))
apartment = Geometry(Tree({0}: [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], {1}: [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]))
stream_filter_2 = StreamFilter(Gate=in_building_type, Stream0=apartment, Stream1=office)
area_2 = Area(Geometry=stream_filter_2)  # -> Area, Centroid
evaluate_surface = EvaluateSurface(Surface=stream_filter_2, Point=area_2.Centroid)  # -> Point, Normal, UDirection, VDirection, Frame
sensorgrid = HBSensorGrid(name=list_item_4, positions=flatten(area_2.Centroid), directions=flatten(evaluate_surface.Normal))  # -> grid; plug-in component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
assigngridsviews = HBAssignGridsAndViews(model=loademodel.model, grids=flatten(sensorgrid))  # -> model; plug-in component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
dumpobjects = HBDumpObjects(hb_objs=flatten(assigngridsviews), name="irrad_model", folder=ghpython_script_4.irradiance_dir, dump=Toggle(True))  # -> out, hb_file; plug-in component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
annualtodata = HBAnnualResultsToData(
    results=ghpython_script_5.a,
    sel_pts=flatten(area_2.Centroid),
    all_pts=area_2.Centroid,
    sel_vecs=flatten(evaluate_surface.Normal),
    all_vecs=evaluate_surface.Normal)  # -> out, data; disabled; plug-in component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
xdata = LBDeconstructData(data=annualtodata.data)  # -> header, values; disabled; plug-in component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
mass_addition = MassAddition(Input=xdata.values)  # -> Result, PartialResults; disabled
trim_tree = TrimTree(Tree=mass_addition.Result, Depth=1)
annualirradiance = HBAnnualIrradiance(model=assigngridsviews, wea=epwpath, radiance_par=radpar, run_settings=recipesettings, run=run_irradiance)  # -> out, results, res_direct, avg_irr, peak_irr, radiation; plug-in component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
out_results = Data(annualirradiance.results)
list_item_10 = ListItem(List=out_results, Index=0, Wrap=True)
text_split_2 = TextSplit(Text=list_item_10, Separators="\")
list_item_11 = ListItem(List=text_split_2, Index=0, Wrap=True)
gradient = Gradient(
    LowerLimit=0,
    UpperLimit=Slider(1451800, range=0..10000000),
    Parameter=trim_tree,
    stops=[0: RGB(75, 107, 169), 0.256: RGB(173, 203, 249), 0.5: RGB(254, 244, 84), 0.733: RGB(234, 126, 0), 1: RGB(234, 38, 0)])
average = Average(Input=annualirradiance.peak_irr)
out_mean_peak = Data(average)
average_2 = Average(Input=annualirradiance.avg_irr)
out_mean_irrad = Data(average_2)
mass_addition_2 = MassAddition(Input=annualirradiance.radiation)  # -> Result, PartialResults
out_bulk = Data(mass_addition_2.Result)
ghpython_script_8 = GhPythonScript(x=flatten([list_item_6, list_item_7, data, list_item_8, list_item_11, out_mean_irrad, out_mean_peak, out_bulk]))  # -> out, a; inputs x: list
# ---------- ghpython_script_8: Python ----------
__author__ = "Justin"
__version__ = "2023.05.06"

import rhinoscriptsyntax as rs
a = ",".join(x)
# ---------- end ghpython_script_8 ----------
data_recorder = DataRecorder(ghpython_script_8.a, DataLimit=-10, RecordData=True)
custom_preview_4 = CustomPreview(Geometry=stream_filter_2, Material=gradient)

# ---- group: Get Cell and Module Information
file = ReadFile(File=cell_info_table, PerLineParse=True)
split = TextSplit(Text=file, Separators=",")
panel_8 = Panel("{0;0}")
flip = FlipMatrix(Data=simplify(split))
split_2 = SplitList(List=flip, Index=Slider(1, range=0..100))  # -> ListA, ListB
row_number = Slider(0, range=0..9)
cset = CreateSet(List=flatten(split_2.ListA))  # -> Set, Map
pd = PathDescription(Data=split_2.ListA)

# ---- group: Get Cell and Module Information / Keys
split_3 = SplitTree(Data=split_2.ListA, Masks=flatten(panel_8))  # -> Positive, Negative

# ---- group: Get Cell and Module Information / Values
split_4 = SplitTree(Data=split_2.ListB, Masks=flatten(panel_8))  # -> Positive, Negative

# ---- group: Get Cell and Module Information / Get Column
list_3 = ItemSelector(
    cset.Set,
    {"scenario", "cell", "orientation", "cec_database_key", "Wp", "gamma_ref", "cell_width", "cell_height", "cell_col_spacing", "cell_row_spacing"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}, selected="scenario")
mindex = MemberIndex(Set=cset.Set, Member=list_3)  # -> Index, Count
item = ListItem(List=flatten(pd), Index=mindex.Index, Wrap=True)
branch = TreeBranch(Tree=split_2.ListB, Path=item, MaintainPaths=True)

# ---- group: Get Cell and Module Information (continued)
mindex_2 = MemberIndex(Set=branch, Member=concat)  # -> Index, Count

# ----
item_2 = ListItem(List=split_3.Negative, Index=mindex_2.Index, Wrap=True)  # -> flatten(Item)
item_3 = ListItem(List=split_4.Negative, Index=mindex_2.Index, Wrap=True)  # -> flatten(Item)
concat_2 = Concatenate(FragmentA=item_2, FragmentB=" : ", FragmentC=item_3)
read_module_info = GhPythonScript(keys=item_2, values=item_3)  # -> out, port, cell_type, cec_key, port_2, n_cols, cell_width, module_width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; inputs keys: list, values: list
# ---------- read_module_info: Python ----------
__author__ = "jmccarty"

import rhinoscriptsyntax as rs
from ast import literal_eval

string_keys = ["scenario","cell","orientation","cec_database_key",]
int_keys = ["n_cols_ideal","n_rows_ideal", "n_cols","n_rows","total_cells","min_cell_module","N_s","N_p","n_submodule","Nsubcell_col","Nsubcell_row"]
mm_keys = ["cell_width","cell_height","cell_col_spacing","cell_row_spacing","frame_size","module_width","module_height"]

new_keys = []
new_values = []
for n, v in enumerate(values):
    k = keys[n]
    new_keys.append(k)
    
    
    if k in string_keys:
        new_values.append(v)
    elif k==int_keys:
        new_values.append(int(v))
    else:
        new_values.append(float(v))

final_keys = []
final_values = []

for n, v in enumerate(new_values):
    k = new_keys[n]
    final_keys.append(k)
    if k in mm_keys:
        final_values.append(float(v) / 1000)
    else:
        final_values.append(v)

parameters = dict(zip(final_keys,final_values))

for k,v in parameters.items():
    print(k,v, type(v))

#------------

cell_type = parameters["cell"]
cec_key = parameters["cec_database_key"]

n_cols = parameters['n_cols']
cell_width = parameters['cell_width']
module_width = parameters['module_width']
Nsubcell_col = parameters['Nsubcell_col']
cell_col_spacing = parameters['cell_col_spacing']
if n_cols==1:
    subcell_width = (n_cols*cell_width) / Nsubcell_col
else:
    subcell_width = cell_width
n_cols_subcell = int(n_cols * Nsubcell_col)
n_cols_ideal = int(parameters['n_cols_ideal'] * Nsubcell_col)


n_rows = parameters['n_rows']
cell_height = parameters['cell_height']
module_height = parameters['module_height']
Nsubcell_row = parameters['Nsubcell_row']
cell_row_spacing = parameters['cell_row_spacing']
if n_rows==1:
    subcell_height = (n_rows*cell_height) / Nsubcell_row
else:
    subcell_height = cell_height
n_rows_subcell = int(n_rows * Nsubcell_row)
n_rows_ideal = int(parameters['n_rows_ideal'] * Nsubcell_row)


min_cell_module = parameters['min_cell_module']
n_submodule = parameters['n_submodule']

frame_size = parameters['frame_size']
# ---------- end read_module_info ----------
ghpython_script_9 = GhPythonScript(
    worst_elevation=maximum,
    worst_azimuth=Slider(225, range=0..360),
    module_length=read_module_info.module_height,
    tilt_angle=stream_filter)  # -> out, D
# ---------- ghpython_script_9: Python ----------
__author__ = "Justin"
__version__ = "2023.05.05"

import rhinoscriptsyntax as rs
from math import tan, sin, cos, radians

h = module_length * sin(tilt_angle)
D1 = h / tan(radians(worst_elevation))
D = max(D1 * cos(radians(180 - worst_azimuth)), D1 * cos(radians(worst_azimuth - 180)))
D = abs(D)
# ---------- end ghpython_script_9 ----------
multiplication = Multiplication(A=read_module_info.module_height, B=cosine)
multiplication_2 = Multiplication(A=read_module_info.module_height, B=sine)
multiplication_3 = Multiplication(A=multiplication, B=Slider(1.05, range=0..10))
maximum_2 = Maximum(A=ghpython_script_9.D, B=multiplication_3)
contour = Contour(Shape=surface_2, Point=list_item_9, Direction=unit_x, Distance=maximum_2)  # -> flatten(Contours)
list_length = ListLength(List=contour)
ghpython_script_10 = GhPythonScript(n_contours=list_length)  # -> out, pattern
# ---------- ghpython_script_10: Python ----------
__author__ = "Justin"
__version__ = "2023.05.05"

import rhinoscriptsyntax as rs

pattern = [1]

keep = [1 for i in range(n_contours-2)]
print(keep)

pattern = pattern + keep + [0]
# ---------- end ghpython_script_10 ----------
dispatch = Dispatch(List=contour, DispatchPattern=ghpython_script_10.pattern)  # -> ListA, ListB
dispatch_2 = Dispatch(List=flatten(dispatch.ListA), DispatchPattern=panel_7)  # -> ListA, ListB
curve = Curve(dispatch_2.ListB)
curve_2 = Curve(dispatch_2.ListA)

# ---- group: Get height of upper rail
unit_z = UnitZ(Factor=1)
amplitude = Amplitude(Vector=unit_z, Amplitude=multiplication_2)
move = Move(Geometry=curve_2, Motion=amplitude)  # -> graft(Geometry), Transform

# ---- group: Set lower rail
amplitude_2 = Amplitude(Vector=unit_x, Amplitude=multiplication)
move_2 = Move(Geometry=curve_2, Motion=amplitude_2)  # -> graft(Geometry), Transform

# ----
reverse = Reverse(Vector=amplitude_2)

# ---- group: Set lower rail (continued)
move_3 = Move(Geometry=curve_2, Motion=reverse)  # -> graft(Geometry), Transform

# ----
loft = Loft(
    Curves=[move_3.Geometry, move.Geometry],
    Options={Adjust=False, Closed=False, LoftEnds=0, LoftSimp=0, LoftType=0, Rebuild=10, Refit=0.01})
loft_2 = Loft(
    Curves=[move_2.Geometry, move.Geometry],
    Options={Adjust=False, Closed=False, LoftEnds=0, LoftSimp=0, LoftType=0, Rebuild=10, Refit=0.01})

deconstruct_brep_2 = DeconstructBrep(Brep=loft)  # -> Faces, Edges, Vertices
length = Length(Curve=deconstruct_brep_2.Edges)
sort_list = SortList(Keys=length, ValuesValuesA=deconstruct_brep_2.Edges)  # -> Keys, ValuesValuesA
list_item_12 = ListItem(List=sort_list.ValuesValuesA, Index=0, Wrap=True)
list_item_13 = ListItem(List=sort_list.ValuesValuesA, Index=1, Wrap=True)
curve_middle = CurveMiddle(Curve=list_item_12)
curve_middle_2 = CurveMiddle(Curve=list_item_13)
vector_2pt = Vector2Pt(PointA=curve_middle, PointB=curve_middle_2, Unitize=False)  # -> Vector, Length
contour_2 = Contour(
    Shape=simplify(loft),
    Point=simplify(curve_middle),
    Direction=simplify(vector_2pt.Vector),
    Distance=read_module_info.module_width)

# ---- group: Contour Surface from Short edge
edges_from_length = EdgesFromLength(Brep=loft_2, Minimum=0, Maximum=read_module_info.module_width)  # -> Edges, Indices
list_item_14 = ListItem(List=edges_from_length.Edges, Index=0, Wrap=True)
list_item_15 = ListItem(List=edges_from_length.Edges, Index=1, Wrap=True)
curve_middle_3 = CurveMiddle(Curve=list_item_14)
curve_middle_4 = CurveMiddle(Curve=list_item_15)
vector_2pt_2 = Vector2Pt(PointA=curve_middle_3, PointB=curve_middle_4, Unitize=False)  # -> Vector, Length
contour_3 = Contour(
    Shape=simplify(loft_2),
    Point=simplify(curve_middle_3),
    Direction=simplify(vector_2pt_2.Vector),
    Distance=read_module_info.module_width)

# ----
trim_tree_2 = TrimTree(Tree=contour_2, Depth=1)
surface_split = SurfaceSplit(Surface=simplify(loft), Curves=trim_tree_2)

# ---- group: split surface
trim_tree_3 = TrimTree(Tree=contour_3, Depth=1)
surface_split_2 = SurfaceSplit(Surface=simplify(loft_2), Curves=trim_tree_3)

# ----
area_3 = Area(Geometry=surface_split)  # -> Area, Centroid
sort_list_2 = SortList(Keys=area_3.Area)  # -> reverse(Keys), ValuesValuesA
list_item_16 = ListItem(List=sort_list_2.Keys, Index=0, Wrap=True)
member_index = MemberIndex(Set=area_3.Area, Member=list_item_16)  # -> Index, Count
list_item_17 = ListItem(List=surface_split, Index=member_index.Index, Wrap=True)  # -> flatten(Item)

# ---- group: Get full sized panels
area_4 = Area(Geometry=surface_split_2)  # -> Area, Centroid
sort_list_3 = SortList(Keys=area_4.Area)  # -> reverse(Keys), ValuesValuesA
list_item_18 = ListItem(List=sort_list_3.Keys, Index=0, Wrap=True)
member_index_2 = MemberIndex(Set=area_4.Area, Member=list_item_18)  # -> Index, Count
list_item_19 = ListItem(List=surface_split_2, Index=member_index_2.Index, Wrap=True)  # -> flatten(Item)

# ---- group: Fix Normals
merge = Merge(Data1=list_item_17, Data2=list_item_19)
area_5 = Area(Geometry=merge)  # -> Area, Centroid
evaluate_surface_2 = EvaluateSurface(Surface=merge, Point=area_5.Centroid)  # -> Point, Normal, UDirection, VDirection, Frame
deconstruct_vector = DeconstructVector(Vector=evaluate_surface_2.Normal)  # -> XComponent, YComponent, ZComponent
smaller_than = SmallerThan(FirstNumber=deconstruct_vector.ZComponent, SecondNumber=Slider(0, range=0..100))  # -> SmallerThan, OrEqualTo
dispatch_3 = Dispatch(List=merge, DispatchPattern=smaller_than.SmallerThan)  # -> ListA, ListB
flip_2 = Flip(Surface=dispatch_3.ListA)  # -> Surface, Result

# ---- group: Split Modules based on nromal
merge_2 = Merge(Data1=flip_2.Surface, Data2=dispatch_3.ListB)
area_6 = Area(Geometry=merge_2)  # -> Area, Centroid
evaluate_surface_3 = EvaluateSurface(Surface=merge_2, Point=area_6.Centroid)  # -> Point, Normal, UDirection, VDirection, Frame
create_set = CreateSet(List=evaluate_surface_3.Normal)  # -> graft(Set), Map
member_index_3 = MemberIndex(Set=evaluate_surface_3.Normal, Member=create_set.Set)  # -> Index, Count
list_item_20 = ListItem(List=merge_2, Index=member_index_3.Index, Wrap=True)  # -> simplify(Item)

# ----
brep_wireframe = BrepWireframe(Brep=list_item_20, Density=-1)
custom_preview_5 = CustomPreview(Geometry=[brep_wireframe, vizwiref], Material=ColourSwatch(SwatchColor=RGB(0, 0, 0)))
custom_preview_6 = CustomPreview(Geometry=list_item_20, Material=ColourSwatch(SwatchColor=RGB(94, 138, 157)))

# ---- group: Build Cells
construct_path = ConstructPath(Indices=Slider(1, range=0..100))
construct_path_2 = ConstructPath(Indices=Slider(0, range=0..100))
tree_branch = TreeBranch(Tree=list_item_20, Path=construct_path, MaintainPaths=True)
tree_branch_2 = TreeBranch(Tree=list_item_20, Path=construct_path_2, MaintainPaths=True)
cluster = Cluster(brep=tree_branch_2)  # -> lower_left_point, surfaces
cluster_2 = Cluster(brep=tree_branch)  # -> lower_left_point, surfaces
evaluate_surface_4 = EvaluateSurface(Surface=cluster.surfaces, Point=cluster.lower_left_point)  # -> Point, Normal, UDirection, VDirection, Frame
evaluate_surface_5 = EvaluateSurface(Surface=cluster_2.surfaces, Point=cluster_2.lower_left_point)  # -> Point, Normal, UDirection, VDirection, Frame
plane_normal = PlaneNormal(Origin=cluster.lower_left_point, ZAxis=evaluate_surface_4.Normal)
plane_normal_2 = PlaneNormal(Origin=cluster_2.lower_left_point, ZAxis=evaluate_surface_5.Normal)
flip_plane = FlipPlane(Plane=plane_normal, FlipX=Toggle(False), FlipY=Toggle(True), FlipZ=True)  # -> Flipped, ResultBoolean
flip_plane_2 = FlipPlane(Plane=plane_normal_2, FlipX=Toggle(False), FlipY=Toggle(True), FlipZ=True)  # -> Flipped, ResultBoolean
cell_builder = CellBuilder(
    frame_thickness=read_module_info.frame_size,
    module_plane=flip_plane.Flipped,
    module_outer_curve=cluster.surfaces,
    cell_cols_spacing=read_module_info.cell_col_spacing,
    cell_row_spacing=read_module_info.cell_row_spacing,
    cell_width=read_module_info.cell_width,
    n_cells_columns=read_module_info.n_cols,
    cell_height=read_module_info.cell_height,
    n_cells_rows=read_module_info.n_rows)  # disabled
cell_builder_2 = CellBuilder(
    frame_thickness=read_module_info.frame_size,
    module_plane=flip_plane_2.Flipped,
    module_outer_curve=cluster_2.surfaces,
    cell_cols_spacing=read_module_info.cell_col_spacing,
    cell_row_spacing=read_module_info.cell_row_spacing,
    cell_width=read_module_info.cell_width,
    n_cells_columns=read_module_info.n_cols,
    cell_height=read_module_info.cell_height,
    n_cells_rows=read_module_info.n_rows)  # disabled

# ==== cluster Cluster
brep = ClusterInput()
brep_2 = Brep(brep)
brep_edges = BrepEdges(Brep=brep_2)  # -> Naked, Interior, NonManifold
join_curves = JoinCurves(Curves=brep_edges.Naked, Preserve=False)  # -> simplify(Curves)
surface = Surface(join_curves)
flatten = FlattenTree(Tree=surface, Path=Slider(1, range=0..1))  # -> graft(Tree)
area = Area(Geometry=flatten)  # -> Area, Centroid
evalsrf = EvaluateSurface(Surface=flatten, Point=area.Centroid)  # -> Point, Normal, UDirection, VDirection, Frame
vec = VectorXYZ(XComponent=Slider(0, range=0..100), YComponent=Slider(1, range=0..1), ZComponent=Slider(0, range=0..100))  # -> Vector, Length
debrep = DeconstructBrep(Brep=flatten)  # -> Faces, Edges, Vertices
trim = TrimTree(Tree=debrep.Vertices, Depth=1)
pdecon = Deconstruct(Point=trim)  # -> XComponent, YComponent, ZComponent
sort = SortList(Keys=pdecon.ZComponent)  # -> Keys, ValuesA
cset = CreateSet(List=sort.Keys)  # -> Set, Map
item = ListItem(List=cset.Set, Index=0, Wrap=True)
mindex = MemberIndex(Set=pdecon.ZComponent, Member=item)  # -> Index, Count
trim_2 = TrimTree(Tree=mindex.Index, Depth=1)
item_2 = ListItem(List=trim, Index=trim_2, Wrap=True)
calc_angle_from_north = GhPythonScript(north_vector=vec.Vector, vector_b=evalsrf.Normal)  # -> out, angle; inputs north_vector: Vector3d, vector_b: Vector3d
# ---------- calc_angle_from_north: Python ----------
__author__ = "jmccarty_teach"

import rhinoscriptsyntax as rs
import math


x1 = north_vector.X
x2 = vector_b.X
y1 = north_vector.Y
y2 = vector_b.Y

a = (x1,y1)
b = (x2,y2)

ang1 = math.atan2(*a[::-1])
ang2 = math.atan2(*b[::-1])

angle = round(math.degrees((ang1 - ang2) % (2 * math.pi)),1)
print(round(angle,1))
# ---------- end calc_angle_from_north ----------
pdecon_2 = Deconstruct(Point=item_2)  # -> XComponent, YComponent, ZComponent
panel = Panel(calc_angle_from_north.angle)
angle_sorter = GhPythonScript(angle=calc_angle_from_north.angle, X=pdecon_2.XComponent, Y=pdecon_2.YComponent)  # -> out, dir, key; inputs X: list, Y: list
# ---------- angle_sorter: Python ----------
__author__ = "jmccarty_teach"

import rhinoscriptsyntax as rs
if angle < 90:
    print("North, largest X")
    dir = "X"
    key = max(X)
elif 90 <= angle < 180:
    print("East, lowest Y")
    dir = "Y"
    key = min(Y)
elif 180 <= angle < 270:
    print("South, lowest X")
    dir = "X"
    key = min(X)
elif angle >= 270:
    print("West, largest Y")
    dir = "Y"
    key = max(Y)
# ---------- end angle_sorter ----------
panel_2 = Panel(angle_sorter.dir)
python = GhPythonScript(dir=angle_sorter.dir, key=angle_sorter.key, x_list=pdecon_2.XComponent, y_list=pdecon_2.YComponent)  # -> out, out_dir, index; inputs x_list: list, y_list: list
# ---------- python: Python ----------
__author__ = "jmccarty_teach"

import rhinoscriptsyntax as rs

if dir=="X":
    out_dir = "X"
    index = x_list.index(key)
else:
    out_dir = "Y"
    index = y_list.index(key)
# ---------- end python ----------
panel_3 = Panel(angle_sorter.key)
item_3 = ListItem(List=item_2, Index=python.index, Wrap=True)
panel_4 = Panel(python.out_dir)
simplify = SimplifyTree(Tree=item_3, Front=False)
simplify_2 = SimplifyTree(Tree=flatten, Front=False)
surfaces = ClusterOutput(simplify_2)
lower_left_point = ClusterOutput(simplify)

# ==== cluster CellBuilder
cell_height = ClusterInput()
n_cells_rows = ClusterInput()
cell_cols_spacing = ClusterInput()
cell_row_spacing = ClusterInput()
cell_width = ClusterInput()
n_cells_columns = ClusterInput()
module_outer_curve = ClusterInput()
module_plane = ClusterInput()
frame_thickness = ClusterInput()
cell_cols_spacing_2 = Number(cell_cols_spacing)

# ---- group: Cell Create Distrubution
n_cells_columns_2 = Number(n_cells_columns)
cell_row_spacing_2 = Number(cell_row_spacing)
n_cells_rows_2 = Number(n_cells_rows)
cell_height_2 = Number(cell_height)
cell_width_2 = Number(cell_width)
module_outer_curve_2 = Curve(module_outer_curve)
frame_thickness_2 = Number(frame_thickness)
module_plane_2 = Plane(module_plane)
graft = GraftTree(Tree=module_plane_2, IncludeEmptyLists=True, IncludeNullItems=True)

# ----
deconstruct_plane = DeconstructPlane(Plane=module_plane_2)  # -> Origin, XAxis, YAxis, ZAxis
graft_2 = GraftTree(Tree=module_outer_curve_2, IncludeEmptyLists=True, IncludeNullItems=True)

# ---- group: Cell Create Distrubution (continued)
module_plane_y_vec = Vector(deconstruct_plane.YAxis)
module_plane_x_vec = Vector(deconstruct_plane.XAxis)
module_origin_point = Point(deconstruct_plane.Origin)
module_plane_z_vec = Vector(deconstruct_plane.ZAxis)
graft_3 = GraftTree(Tree=module_plane_z_vec, IncludeEmptyLists=True, IncludeNullItems=True)
trim_helper = TrimHelper(output_paths=graft, input_paths=graft_2)

# ----
graft_4 = GraftTree(Tree=module_origin_point, IncludeEmptyLists=True, IncludeNullItems=True)
graft_5 = GraftTree(Tree=module_plane_x_vec, IncludeEmptyLists=True, IncludeNullItems=True)
graft_6 = GraftTree(Tree=module_plane_y_vec, IncludeEmptyLists=True, IncludeNullItems=True)

# ---- group: Cell Create Distrubution (continued)
item = ListItem(List=graft_4, Index=0, Wrap=True)

# ---- group: Move module origin to adjust for frame thickness
amp = Amplitude(Vector=graft_5, Amplitude=frame_thickness_2)
move = Move(Geometry=item, Motion=amp)  # -> Geometry, Transform
amp_2 = Amplitude(Vector=graft_6, Amplitude=frame_thickness_2)
move_2 = Move(Geometry=move.Geometry, Motion=amp_2)  # -> Geometry, Transform

# ---- group: Inner Offset Module for frame thickness
neg = Negative(Value=frame_thickness_2)
offset = OffsetCurve(Curve=graft_2, Distance=neg, Plane=trim_helper, Corners=1)
trim_helper_2 = TrimHelper(output_paths=offset, input_paths=graft_2)

# ---- group: Get Vector for move from cell origin to center
division = Division(A=cell_width_2, B=2)
amp_3 = Amplitude(Vector=graft_5, Amplitude=division)
division_2 = Division(A=cell_height_2, B=2)
move_3 = Move(Geometry=move_2.Geometry, Motion=amp_3)  # -> Geometry, Transform
amp_4 = Amplitude(Vector=graft_6, Amplitude=division_2)
move_4 = Move(Geometry=move_3.Geometry, Motion=amp_4)  # -> Geometry, Transform
vec2pt = Vector2Pt(PointA=move_2.Geometry, PointB=move_4.Geometry, Unitize=False)  # -> Vector, Length

# ---- group: Move in Y
series = Series(Start=0, Step=1, Count=n_cells_rows_2)
multiplication = Multiplication(A=cell_height_2, B=series)
addition = Addition(A=multiplication, B=cell_row_spacing_2)
amp_5 = Amplitude(Vector=graft_6, Amplitude=addition)
move_5 = Move(Geometry=move_2.Geometry, Motion=amp_5)  # -> Geometry, Transform

# ---- group: Move in X
series_2 = Series(Start=0, Step=1, Count=n_cells_columns_2)
multiplication_2 = Multiplication(A=cell_width_2, B=series_2)
addition_2 = Addition(A=multiplication_2, B=cell_cols_spacing_2)
group = Group(Objects=move_5.Geometry)
amp_6 = Amplitude(Vector=graft_5, Amplitude=addition_2)
move_6 = Move(Geometry=group, Motion=amp_6)  # -> Geometry, Transform

# ---- group: Move Diagonal
move_7 = Move(Geometry=move_6.Geometry, Motion=vec2pt.Vector)  # -> Geometry, Transform

# ----
ungroup = Ungroup(Group=move_7.Geometry)
pd = PathDescription(Data=ungroup)
item_2 = ListItem(List=pd, Index=0, Wrap=True)

# ---- group: Test for Inclusion
number_slider = Slider(0.05, range=0..0.1)
trim_helper_3 = TrimHelper(output_paths=item_2, input_paths=trim_helper_2)
lng = ListLength(List=trim_helper_3)

# ----
neg_2 = Negative(Value=number_slider)
offsrf = OffsetSurface(Surface=trim_helper_2, Distance=number_slider, BothSides=neg_2, CreateSolid=True)
trim_helper_4 = TrimHelper(output_paths=offsrf, input_paths=trim_helper_2)
panel = Panel(lng)

# ---- group: Test for Inclusion (continued)
repeat = RepeatData(Data=trim_helper_4, Length=lng)
assign_paths = AssignPaths(InputData=flatten(repeat), PathsToAssign=flatten(item_2))
brepinc = PointInBrep(Brep=assign_paths, Point=ungroup, Strict=False)
dispatch = Dispatch(List=ungroup, DispatchPattern=brepinc)  # -> ListA, ListB

# ----
pt = Point(dispatch.ListA)
clean = CleanTree(RemoveNulls=True, RemoveInvalid=True, RemoveEmpty=True, Tree=pt)
cell_points = ClusterOutput(clean)

# ==== cluster TrimHelper
output_paths = ClusterInput()
input_paths = ClusterInput()
pd = PathDescription(Output_paths=output_paths)  # -> flatten(Paths)
pd_2 = PathDescription(Input_paths=input_paths)  # -> flatten(Paths)
item = ListItem(List=pd_2, Index=0, Wrap=True)
item_2 = ListItem(List=pd, Index=0, Wrap=True)
trim_if_path_longer = GhPythonScript(input_path=item, output_path=item_2)  # -> out, trim_bool, trim_number
# ---------- trim_if_path_longer: Python ----------
__author__ = "jmccarty"

import rhinoscriptsyntax as rs

input_ = len(input_path.split(";"))
output_ = len(output_path.split(";"))

if input_==output_:
    trim_bool = False
    trim_number = 0
else:
    trim_bool = True
    trim_number = output_ - input_
# ---------- end trim_if_path_longer ----------
trim = TrimTree(Input_data=output_paths, Depth=trim_if_path_longer.trim_number)
data = ClusterOutput(trim)
